# Grasshopper definition First Code.gh (Grasshopper 1.0.7)

python = GhPythonScript(x=Slider(4.5, range=0..10), y=Slider(3.45, range=0..10))  # -> out, a, b, c
# ---------- python: Python ----------
#importing modules. (导入模块的3种方式)
import rhinoscriptsyntax as rs
from Rhino.Geometry import Point3d
ma = __import__("math")



text = "hello world"
print text

# comment (单行注释#)
a = rs.AddPoint(0,0,0)

"""
(多行注释""""""")
Creating a point using Rhinocommon.(使用Rhinocommon创建一个点)
"""
b = Point3d(10,10,10)


c = x + y
# ---------- end python ----------
panel = Panel(python.b)
panel_2 = Panel(python.out)
panel_3 = Panel(python.a)
panel_4 = Panel(python.c)
