# Grasshopper definition Math Library.gh (Grasshopper 1.0.7)

python = GhPythonScript()  # -> out, a, b
# ---------- python: Python ----------
import rhinoscriptsyntax as rs
import math

a = []
for i in range(500):
    x = math.cos(i*0.1) * i*0.1
    y = math.sin(i*0.1) * i*0.08
    if(i < 200):
        z = i*0.05
    else:
        z = 20-i*0.05
    p = rs.AddPoint(x,y,z)
    a.append(p)

b = rs.AddCurve(a)
# ---------- end python ----------
