# Grasshopper definition 2D Nested For Loop.gh (Grasshopper 1.0.7)

python = GhPythonScript()  # -> out, pts, srf
# ---------- python: Python ----------
import Rhino.Geometry as rg
import math

pts = []
for i in range(100):
    for j in range(50):
        x = i*0.5
        y = j*0.5
        z = math.sin(i*0.1)*1;
        if(j%20 < 10):
            z *= (j%20)*0.2;
        else:
            z *= (20 - j%20)*0.2;
        pts.append(rg.Point3d(x,y,z))

srf = rg.NurbsSurface.CreateFromPoints(pts,100,50,3,3)
# ---------- end python ----------
preview = CustomPreview(
    Geometry=python.srf,
    Material={diffuse=RGB(221, 160, 221), emission=RGB(66, 48, 66), shine=0.5, specular=RGB(255, 255, 255), transparency=0})
