# Grasshopper definition And Condition in Loop.gh (Grasshopper 1.0.7)

number_slider = Slider(100, range=0..100)
python = GhPythonScript(u_count=number_slider, v_count=number_slider)  # -> out, pts, srf; inputs u_count: Int32, v_count: Int32
# ---------- python: Python ----------
import Rhino.Geometry as rg
import math

pts = []
for i in range(u_count):
    for j in range(v_count):
        x = i*0.5
        y = j*0.5
        if( i<20 and j<20 ):
            z = 2
        elif( i>=20 and i<40 and j>=60 and j<80):
            z = 1
        elif( i==50 or j==50):
            z = 2
        elif( i>=60 and i<80 and j>=20 and j<80):
            z = math.cos(j*0.2)+2
        elif( not i>60 and j>=25 and j<35):
            z = 8 - i*0.1
        elif( not (i<90 and j<90) ):
             z = math.sin(i*0.2) * math.cos(j*0.2)+2
        else:
            z = math.cos(i*0.1) * math.sin(j*0.1)
        pts.append(rg.Point3d(x,y,z))

srf = rg.NurbsSurface.CreateFromPoints(pts,u_count,v_count,3,3)
# ---------- end python ----------
preview = CustomPreview(
    Geometry=python.srf,
    Material={diffuse=RGB(221, 160, 221), emission=RGB(66, 48, 66), shine=0.5, specular=RGB(255, 255, 255), transparency=0})
