# Grasshopper definition IntegerFloat Input.gh (Grasshopper 1.0.7)

python = GhPythonScript(
    u_count=Slider(80, range=0..100),
    v_count=Slider(50, range=0..100),
    z=Slider(4.2, range=0..10),
    u=Slider(0.3, range=0..1))  # -> out, pts, srf; inputs u_count: Int32, v_count: Int32
# ---------- python: Python ----------
import Rhino.Geometry as rg
import math

pts = []
for i in range(u_count):
    for j in range(v_count):
        p = rg.Point3d(i, j, math.sin(i*u) * math.sin(j*u) * z)
        pts.append(p)
#Creating a grid of points using list comprehension.
#pts2 = [rg.Point3d(i, j, math.sin(i*u) * math.sin(j*u) * z)  for i in range(u_count) for j in range(v_count)]
srf = rg.NurbsSurface.CreateFromPoints(pts,u_count,v_count,3,3)
# ---------- end python ----------
