# Grasshopper definition Point Input.gh (Grasshopper 1.0.7)

pop2d = Populate2D(
    Region={Plane=PlaneXY(31.55571972, 6.916183631, 0), Size=Domain2(u=-32.31709943..32.31709943, v=-15.02387263..15.02387263)},
    Count=Slider(100, range=0..100),
    Seed=1)
python = GhPythonScript(pts=pop2d)  # -> out, a; inputs pts: list of Point3d
# ---------- python: Python ----------
import rhinoscriptsyntax as rs
import math

a = []
b = []
c = []
for pt in pts:
    if(pt.X % 3 < 0.5):
        a.append(pt)
    elif( math.sqrt(abs(pt.Y)) %0.5 < 0.1):
        b.append(pt)
        """
        The math.sqrt function does not accept negative numbers,
        so it needs to be preceded by the abs function to take the absolute value.
        math.sqrt函数不能输入负数，所以需要加一个abs函数取绝对值.
        """
    else:
        c.append(pt)
# ---------- end python ----------
