# Grasshopper definition 2-3. Point Input (2).gh (Grasshopper 1.0.7)

P = Plane(PlaneXY(0, 0, 0))
hexgrid = Hexagonal(Plane=P, Size=1, ExtentX=Slider(25, range=0..100), ExtentY=Slider(20, range=0..100))  # -> Cells, Points
pt = Point(Point(23.28184594, 7.890103272, 0))
python = PythonScript(pts=flatten(hexgrid.Points), attr=pt)  # -> out, a, b; inputs pts: list of Point3d, attr: Point3d
# ---------- python: Python ----------
import rhinoscriptsyntax as rs
import Rhino.Geometry as rg     

a = []
b = []
for pt in pts:
    if( pt.Y % 10 > 0 and pt.Y % 10 < 2):
        rect = rs.AddRectangle(rg.Plane.WorldXY, 1.5, 0.4)
        rs.MoveObject(rect, pt)
        rs.MoveObject(rect, rg.Vector3d(-0.75,-0.2,0))
        a.append(rect)
    else:
        dist = rs.Distance(pt, attr)
        circle = rs.AddCircle(pt, 0.02*dist)
        b.append(circle)
# ---------- end python ----------
crv = Curve(python.b)
