# Grasshopper definition Point Clustering.gh (Grasshopper 1.0.7)

number_slider = Slider(12, range=0..23)
pop2d = Populate2D(
    Region={Plane=PlaneXY(115.1433979, 108.8672683, 0), Size=Domain2(u=-115.1433979..115.1433979, v=-108.8672683..108.8672683)},
    Count="600",
    Seed=1)
pt = Point(pop2d)
python = GhPythonScript(pts=pt, threshold=number_slider)  # -> out, a; inputs pts: list of Point3d
# ---------- python: Python ----------
import Rhino.Geometry as rg
import scriptcontext as sc


a = []

#初始化字典
for i in xrange(len(pts)):sc.sticky[i] = []

sq_dis = threshold*threshold

# 计算所有点之间的距离，并记录靠近的点
for i, pt in enumerate(pts):
    for j, pt2 in enumerate(pts[i+1:], i+1):
        if pt.DistanceToSquared(pt2) < sq_dis:
            sc.sticky[i].append(pt2)
            sc.sticky[j].append(pt)
    
    # 构建连接线
    close_pts = sc.sticky[i]
    count = len(close_pts)
    if count > 2:
        zpt = rg.Point3d(pt.X, pt.Y, 0.5 * (count - 2))
        lines = [rg.Line(zpt, cpt) for cpt in close_pts]
        a.extend(lines)
# ---------- end python ----------
python_2 = GhPythonScript(pts=pt, threshold=number_slider)  # -> out, a; inputs pts: list of Point3d
# ---------- python_2: Python ----------
import rhinoscriptsyntax as rs

a = []
for pt in pts:
    closePts = []
    for pt2 in pts:
        dist = rs.Distance(pt, pt2)
        if(dist > 0 and dist < threshold): # exclude itself by > 0
            closePts.append(pt2)
    
    count = len(closePts)
    if(count >= 3):
        for cpt in closePts:
            zpt = rs.AddPoint(pt.X, pt.Y, 0.5*(count-2))
            line = rs.AddLine(zpt, cpt)
            a.append(line)
# ---------- end python_2 ----------

# ---- group: Rhinocommon
python_3 = GhPythonScript(pts=pt, threshold=number_slider)  # -> out, a; inputs pts: list of Point3d
# ---------- python_3: Python ----------
import Rhino.Geometry as rg


a = []
for pt in pts:
    closePts = []
    for pt2 in pts:
        dist = pt.DistanceTo(pt2)
        if(dist > 0 and dist < threshold): # exclude itself by > 0
            closePts.append(pt2)
    
    count = len(closePts)
    if(count >= 3):
        for cpt in closePts:
            zpt = rg.Point3d(pt.X, pt.Y, 0.5*(count-2))
            line = rg.Line(zpt, cpt)
            a.append(line)
# ---------- end python_3 ----------
